# Grasshopper definition gear.gh (Grasshopper 1.0.7)

teeth_number = Slider(21, range=1..101)
rotation = Slider(0, range=0..360)
depth = Slider(5, range=5..10)
inner_dia = Slider(10, range=4..12)
teeth_number_2 = GetInteger(teeth_number, AtLeast=1, AtMost=1, Maximum=2147483647, Minimum=-2147483648)
rotation_2 = GetInteger(rotation, AtLeast=1, AtMost=1, Maximum=2147483647, Minimum=-2147483648)

depth_2 = GetInteger(depth, AtLeast=1, AtMost=1, Maximum=2147483647, Minimum=-2147483648)
inner_dia_2 = GetInteger(inner_dia, AtLeast=1, AtMost=1, Maximum=2147483647, Minimum=-2147483648)

# ----
# Teeth # 1
panel = Panel("2")
multiplication = Multiplication(A=teeth_number_2, B=panel)

width = Panel("20")
value_btw_in_out = Addition(A=width, B=Slider(1.5, range=0..2))

# ----
# Shape # 1
pt = ConstructPoint(XCoordinate=0, YCoordinate=0, ZCoordinate=0)
pt_2 = ConstructPoint(XCoordinate=0, YCoordinate=0, ZCoordinate=0)
outer = Circle(Plane=pt, Radius=value_btw_in_out)
inner = Circle(Plane=pt_2, Radius=width)

inner_hole = OffsetCurve(Curve=outer, Distance=expr("-x", inner_dia_2), Corners=1)

# ----
# Gap # 1 & 2
panel_2 = Panel("2")
multiplication_2 = Multiplication(A=value_btw_in_out, B=panel_2)
subtraction = Subtraction(A=multiplication_2, B="1")
X = UnitX(Factor=subtraction)

# ----
# Gap # 1 & 2
panel_3 = Panel("2")
multiplication_3 = Multiplication(A=value_btw_in_out, B=panel_3)
subtraction_2 = Subtraction(A=multiplication_3, B="1")
Y = UnitY(Factor=subtraction_2)

# ----
# Teeth # 1
teeth_division = DivideCurve(Curve=inner, Count=multiplication, Kinks=False)  # -> Points, Tangents, Parameters
teeth_division_2 = DivideCurve(Curve=outer, Count=teeth_number_2, Kinks=False)  # -> Points, Tangents, Parameters
panel_4 = Panel("""0
1""")
cull = CullPattern(List=teeth_division.Points, CullPattern=panel_4)
weave = Weave(Pattern=[0, 1], Stream0=teeth_division_2.Points, Stream1=cull, NullGaps=False)

# ---- group: 1st
pline = PolyLine(Vertices=weave, Closed=invert(False))

# ----
# Move + Rotation # 2
default_set = Slider(26, range=0..360)
move = Move(Geometry=pline, Motion=Y)  # -> Geometry, Transform
area = Area(Geometry=move.Geometry)  # -> Area, Centroid
line = LineSDL(Start=area.Centroid, Direction=Vector(0, 0, 1), Length=1)
addition = Addition(A=rotation_2, B=default_set)
_2nd_rot = Rotate3D(Geometry=move.Geometry, Angle=degrees(addition), Center=area.Centroid, Axis=line)  # -> Geometry, Transform

# ----
# Move + Rotation # 2
move_2 = Move(Geometry=pline, Motion=X)  # -> Geometry, Transform
area_2 = Area(Geometry=move_2.Geometry)  # -> Area, Centroid
line_2 = LineSDL(Start=area_2.Centroid, Direction=Vector(0, 0, 1), Length=1)
_2nd_rot_2 = Rotate3D(Geometry=move_2.Geometry, Angle=degrees(rotation_2), Center=area_2.Centroid, Axis=line_2)  # -> Geometry, Transform

# ----
# Rotation # 1
area_3 = Area(Geometry=pline)  # -> Area, Centroid
line_3 = LineSDL(Start=area_3.Centroid, Direction=Vector(0, 0, 1), Length=1)
neg = Negative(Value=rotation_2)
_1st_rot = Rotate3D(Geometry=pline, Angle=degrees(neg), Center=area_3.Centroid, Axis=line_3)  # -> Geometry, Transform

addition_2 = Addition(B="180")

# ----
# Depth # 1
fillet = Slider(0, range=0..1)
fillet_2 = Fillet(Curve=_1st_rot.Geometry, Radius=fillet)
Z = UnitZ(Factor=depth_2)
crv = Curve(inner_hole)
boundary = BoundarySurfaces(Edges=[crv, fillet_2])
extr = Extrude(Base=[crv, fillet_2], Direction=Z)
move_3 = Move(Geometry=boundary, Motion=Z)  # -> Geometry, Transform
join = BrepJoin(Breps=[boundary, extr, move_3.Geometry])  # -> Breps, Closed

# ----
# Depth # 2
move_4 = Move(Geometry=inner_hole, Motion=X)  # -> Geometry, Transform
fillet_3 = Fillet(Curve=_2nd_rot_2.Geometry, Radius=fillet)
Z_2 = UnitZ(Factor=depth_2)
boundary_2 = BoundarySurfaces(Edges=[move_4.Geometry, fillet_3])
move_5 = Move(Geometry=boundary_2, Motion=Z_2)  # -> Geometry, Transform
extr_2 = Extrude(Base=[move_4.Geometry, fillet_3], Direction=Z_2)
join_2 = BrepJoin(Breps=[extr_2, move_5.Geometry, boundary_2])  # -> Breps, Closed

# ----
# Depth # 2
fillet_4 = Fillet(Curve=_2nd_rot.Geometry, Radius=fillet)
Z_3 = UnitZ(Factor=depth_2)
move_6 = Move(Geometry=inner_hole, Motion=Y)  # -> Geometry, Transform
boundary_3 = BoundarySurfaces(Edges=[move_6.Geometry, fillet_4])
extr_3 = Extrude(Base=[move_6.Geometry, fillet_4], Direction=Z_3)
move_7 = Move(Geometry=boundary_3, Motion=Z_3)  # -> Geometry, Transform
join_3 = BrepJoin(Breps=[extr_3, move_7.Geometry, boundary_3])  # -> Breps, Closed

wires = BrepWireframe(Brep=move_5.Geometry, Density=-1)
item = ListItem(List=wires, Index=-1, Wrap=True)
explode = Explode(Curve=wires, Recursive=True)  # -> Segments, Vertices
cull_i = CullIndex(List=flatten(explode.Vertices), Indices=[-2, -1], Wrap=True)
addition_3 = Addition(A=depth_2, B="11")
crv_cp = CurveClosestPoint(Point=cull_i, Curve=item)  # -> Point, Parameter, Distance
Z_4 = UnitZ(Factor=addition_3)
ln = Line(StartPoint=cull_i, EndPoint=crv_cp.Point)
ext = ExtendCurve(Curve=ln, Type=0, Start="2", End="2")
extr_4 = Extrude(Base=ext, Direction=Z_4)
bbx = BrepBrep(BrepA=extr_4, BrepB=move_5.Geometry)  # -> Curves, Points
trim = TrimTree(Tree=bbx.Curves, Depth=1)
srfsplit = SurfaceSplit(Surface=move_5.Geometry, Curves=trim)
item_2 = ListItem(List=srfsplit, Index=0, Wrap=True)
lng = ListLength(List=flatten(srfsplit))
Z_5 = UnitZ(Factor="0.1")
range = Range(Domain=Domain(0, 1), Steps=lng)
move_8 = Move(Geometry=srfsplit, Motion=Z_5)  # -> Geometry, Transform
gradient = Gradient(LowerLimit=0, UpperLimit=1, Parameter=range, stops=[0: RGB(255, 255, 255), 1: RGB(0, 0, 0)])
preview = CustomPreview(Geometry=move_8.Geometry, Material=gradient)

wires_2 = BrepWireframe(Brep=move_7.Geometry, Density=-1)
item_3 = ListItem(List=wires_2, Index=-1, Wrap=True)
explode_2 = Explode(Curve=wires_2, Recursive=True)  # -> Segments, Vertices
cull_i_2 = CullIndex(List=flatten(explode_2.Vertices), Indices=[-2, -1], Wrap=True)
addition_4 = Addition(A=depth_2, B="11")
crv_cp_2 = CurveClosestPoint(Point=cull_i_2, Curve=item_3)  # -> Point, Parameter, Distance
Z_6 = UnitZ(Factor=addition_4)
ln_2 = Line(StartPoint=cull_i_2, EndPoint=crv_cp_2.Point)
ext_2 = ExtendCurve(Curve=ln_2, Type=0, Start="2", End="2")
extr_5 = Extrude(Base=ext_2, Direction=Z_6)
bbx_2 = BrepBrep(BrepA=extr_5, BrepB=move_7.Geometry)  # -> Curves, Points
trim_2 = TrimTree(Tree=bbx_2.Curves, Depth=1)
srfsplit_2 = SurfaceSplit(Surface=move_7.Geometry, Curves=trim_2)
item_4 = ListItem(List=srfsplit_2, Index=0, Wrap=True)
lng_2 = ListLength(List=flatten(srfsplit_2))
Z_7 = UnitZ(Factor="0.1")
range_2 = Range(Domain=Domain(0, 1), Steps=lng_2)
move_9 = Move(Geometry=srfsplit_2, Motion=Z_7)  # -> Geometry, Transform
gradient_2 = Gradient(LowerLimit=0, UpperLimit=1, Parameter=range_2, stops=[0: RGB(255, 255, 255), 1: RGB(0, 0, 0)])
preview_2 = CustomPreview(Geometry=move_9.Geometry, Material=gradient_2)

wires_3 = BrepWireframe(Brep=move_3.Geometry, Density=-1)
item_5 = ListItem(List=wires_3, Index=-1, Wrap=True)
explode_3 = Explode(Curve=wires_3, Recursive=True)  # -> Segments, Vertices
cull_i_3 = CullIndex(List=flatten(explode_3.Vertices), Indices=[-2, -1], Wrap=True)
addition_5 = Addition(A=depth_2, B="11")
crv_cp_3 = CurveClosestPoint(Point=cull_i_3, Curve=item_5)  # -> Point, Parameter, Distance
Z_8 = UnitZ(Factor=addition_5)
ln_3 = Line(StartPoint=cull_i_3, EndPoint=crv_cp_3.Point)
ext_3 = ExtendCurve(Curve=ln_3, Type=0, Start="2", End="2")
extr_6 = Extrude(Base=ext_3, Direction=Z_8)
bbx_3 = BrepBrep(BrepA=extr_6, BrepB=move_3.Geometry)  # -> Curves, Points
trim_3 = TrimTree(Tree=bbx_3.Curves, Depth=1)
srfsplit_3 = SurfaceSplit(Surface=move_3.Geometry, Curves=trim_3)
item_6 = ListItem(List=srfsplit_3, Index=0, Wrap=True)
lng_3 = ListLength(List=flatten(srfsplit_3))
Z_9 = UnitZ(Factor="0.1")
range_3 = Range(Domain=Domain(0, 1), Steps=lng_3)
move_10 = Move(Geometry=srfsplit_3, Motion=Z_9)  # -> Geometry, Transform
gradient_3 = Gradient(LowerLimit=0, UpperLimit=1, Parameter=range_3, stops=[0: RGB(221, 0, 255), 1: RGB(0, 255, 255)])
preview_3 = CustomPreview(Geometry=move_10.Geometry, Material=gradient_3)

mesh = MeshBrep(
    Brep=[join_2.Breps, join.Breps, join_3.Breps],
    Settings={GridMaxCount=0, GridMinCount=16, JaggedSeams=False, MaxEdgeLength=0, MinEdgeLength=0.0001, MinTolerance=0, Refine=True, RefineAngle=0, RelativeTolerance=0.65, SimplePlanes=True, Tolerance=0})
mcol = MeshColours(Mesh=mesh, Colours=ColourSwatch(SwatchColor=RGB(255, 255, 255)))

mesh_2 = MeshBrep(
    Brep=move_10.Geometry,
    Settings={GridMaxCount=0, GridMinCount=16, JaggedSeams=False, MaxEdgeLength=0, MinEdgeLength=0.0001, MinTolerance=0, Refine=True, RefineAngle=0, RelativeTolerance=0.65, SimplePlanes=True, Tolerance=0})
mesh_3 = MeshBrep(
    Brep=move_8.Geometry,
    Settings={GridMaxCount=0, GridMinCount=16, JaggedSeams=False, MaxEdgeLength=0, MinEdgeLength=0.0001, MinTolerance=0, Refine=True, RefineAngle=0, RelativeTolerance=0.65, SimplePlanes=True, Tolerance=0})
mesh_4 = MeshBrep(
    Brep=move_9.Geometry,
    Settings={GridMaxCount=0, GridMinCount=16, JaggedSeams=False, MaxEdgeLength=0, MinEdgeLength=0.0001, MinTolerance=0, Refine=True, RefineAngle=0, RelativeTolerance=0.65, SimplePlanes=True, Tolerance=0})
mcol_2 = MeshColours(Mesh=graft(mesh_2), Colours=graft(gradient_3))
mcol_3 = MeshColours(Mesh=graft(mesh_4), Colours=graft(gradient_3))
mcol_4 = MeshColours(Mesh=graft(mesh_3), Colours=graft(gradient_3))

# ---- group: RH_OUT:mesh
mesh_5 = Mesh(flatten([mcol, mcol_2, mcol_4, mcol_3]))
